# Grasshopper definition Small_Block.gh (Grasshopper 1.0.7)
# plug-ins: Human

panel = Panel("C:\Users\Xiting Chen\Downloads\map (1).osm")  # disabled
path = FilePath(panel)  # disabled
loc = Location(FilePText=path)  # -> OSMPointData, OSMData, LongitudeDomain, LatitudeDomain; disabled
majrds = MajorRoads(OSMPointData=loc.OSMPointData, OSMDataText=loc.OSMData, CollectionType=0)  # -> Primary, PrimaryLinks, Secondary, SecondaryLinks, Tertiary, FeatureKey; disabled
hwy = Highways(OSMPointData=loc.OSMPointData, OSMDataText=loc.OSMData, CollectionType=0)  # -> Motorways, MotorwayLinks, Trunks, TrunkLinks, FeatureKey; disabled
rail = Railways(OSMPointData=loc.OSMPointData, OSMDataText=loc.OSMData, CollectionType=0)  # -> Rail, Tram, LightRail, Subway, MonoRail, NarrowGauge, FeatureKey; disabled
minrds = MinorRoads(OSMPointData=loc.OSMPointData, OSMDataText=loc.OSMData, CollectionType=0)  # -> Residential, UnclassifiedRoads, NotClassified, FeatureKey; disabled
pline = PolyLine(Vertices=hwy.Motorways, Closed=False)  # disabled
pline_2 = PolyLine(Vertices=majrds.Primary, Closed=False)  # disabled
pline_3 = PolyLine(Vertices=majrds.PrimaryLinks, Closed=False)  # disabled
pline_4 = PolyLine(Vertices=majrds.Secondary, Closed=False)  # disabled
pline_5 = PolyLine(Vertices=majrds.SecondaryLinks, Closed=False)  # disabled
pline_6 = PolyLine(Vertices=majrds.Tertiary, Closed=False)  # disabled
pline_7 = PolyLine(Vertices=hwy.Trunks, Closed=False)  # disabled
pline_8 = PolyLine(Vertices=hwy.MotorwayLinks, Closed=False)  # disabled
pline_9 = PolyLine(Vertices=hwy.TrunkLinks, Closed=False)  # disabled
pline_10 = PolyLine(Vertices=minrds.Residential, Closed=False)  # disabled
pline_11 = PolyLine(Vertices=minrds.UnclassifiedRoads, Closed=False)  # disabled
swatch = ColourSwatch(SwatchColor=RGB(0, 47, 255))  # disabled
swatch_2 = ColourSwatch(SwatchColor=RGB(255, 0, 0))  # disabled
swatch_3 = ColourSwatch(SwatchColor=RGB(255, 0, 0))  # disabled
swatch_4 = ColourSwatch(SwatchColor=RGB(255, 200, 0))  # disabled
swatch_5 = ColourSwatch(SwatchColor=RGB(255, 200, 0))  # disabled
swatch_6 = ColourSwatch(SwatchColor=RGB(0, 0, 0))  # disabled
swatch_7 = ColourSwatch(SwatchColor=RGB(0, 72, 255))  # disabled
swatch_8 = ColourSwatch(SwatchColor=RGB(0, 55, 255))  # disabled
swatch_9 = ColourSwatch(SwatchColor=RGB(0, 42, 255))  # disabled
swatch_10 = ColourSwatch(SwatchColor=RGB(128, 128, 128))  # disabled
swatch_11 = ColourSwatch(SwatchColor=RGB(128, 128, 128))  # disabled
preview = CustomPreview(Geometry=pline, Material=swatch)  # disabled
preview_2 = CustomPreview(Geometry=pline_2, Material=swatch_2)  # disabled
preview_3 = CustomPreview(Geometry=pline_3, Material=swatch_3)  # disabled
preview_4 = CustomPreview(Geometry=pline_4, Material=swatch_4)  # disabled
preview_5 = CustomPreview(Geometry=pline_5, Material=swatch_5)  # disabled
preview_6 = CustomPreview(Geometry=pline_6, Material=swatch_6)  # disabled
preview_7 = CustomPreview(Geometry=pline_7, Material=swatch_7)  # disabled
preview_8 = CustomPreview(Geometry=pline_8, Material=swatch_8)  # disabled
preview_9 = CustomPreview(Geometry=pline_9, Material=swatch_9)  # disabled
preview_10 = CustomPreview(Geometry=pline_10, Material=swatch_10)  # disabled
preview_11 = CustomPreview(Geometry=pline_11, Material=swatch_11)  # disabled

pt = Point([<point referenced from the Rhino model> x6])
crv = Curve(<curve referenced from the Rhino model>)

boundary = BoundarySurfaces(Edges=crv)
sdivide = DivideSurface(Surface=boundary, UCount="50", VCount="50")  # -> Points, Normals, Parameters
graft = GraftTree(Tree=sdivide.Points, IncludeEmptyLists=True, IncludeNullItems=True)
dist = Distance(PointA=pt, PointB=graft)
sort = SortList(Keys=dist)  # -> Keys, ValuesA
dom = ConstructDomain(DomainStart="300", DomainEnd="0")
item = ListItem(List=sort.Keys, Index=0, Wrap=True)
flatten = FlattenTree(Tree=item, Path="{0}")
bnd = Bounds(Numbers=flatten)
remap = RemapNumbers(Value=item, Source=bnd, Target=dom)  # -> Mapped, Clipped
Z = UnitZ(Factor=remap.Mapped)
move = Move(Geometry=graft, Motion=Z)  # -> simplify(Geometry), Transform
path_mapper = PathMapper(move.Geometry, source="{A;B}", target="{A}")
lng = ListLength(List=path_mapper)
srfgrid = SurfaceFromPoints(Points=flatten(path_mapper), UCount=lng, Interpolate=False)
srf = Surface(srfgrid)

pt_attractor = Point([<point referenced from the Rhino model> x4])
crv_streets = Curve([<curve referenced from the Rhino model> x170])
srf_topo = Surface(srf)
crv_river = Curve([<curve referenced from the Rhino model> x6])
crv_site = Curve(<curve referenced from the Rhino model>)

crv_streets_2 = Curve(crv_streets)
objatts = ObjectAttributes(ObjectOrAttributes=crv_streets_2)  # -> Name, LayerName, LayerFullPath, Color, MaterialName, LinetypeName, GroupIndices, PlotWeight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
item_2 = ListItem(List=objatts.UserDataValues, Index=0, Wrap=True)  # -> flatten(Item)
cset = CreateSet(List=item_2)  # -> graft(Set), Map
equals = Equality(FirstNumber=cset.Set, SecondNumber=item_2)  # -> Equality, Inequality
cull = CullPattern(List=crv_streets_2, CullPattern=equals.Equality)
join = JoinCurves(Curves=cull, Preserve=False)
lng_2 = ListLength(List=join)
dup = DuplicateData(Data=cset.Set, Number=lng_2, Order=True)

crv_site_2 = Curve(crv_site)
crv_river_2 = Curve(crv_river)

boundary_2 = BoundarySurfaces(Edges=crv_site_2)
area = Area(Geometry=crv_river_2)  # -> Area, Centroid
srfsplit = SurfaceSplit(Surface=boundary_2, Curves=crv_river_2)  # -> graft(Fragments)
srf_cp = SurfaceClosestPoint(Point=area.Centroid, Surface=srfsplit)  # -> Point, UVPoint, Distance
sort_2 = SortList(Keys=srf_cp.Distance)  # -> Keys, ValuesA
item_3 = ListItem(List=sort_2.Keys, Index=0, Wrap=True)
smaller = SmallerThan(FirstNumber=item_3, SecondNumber="0.1")  # -> SmallerThan, OrEqualTo
dispatch = Dispatch(List=srfsplit, DispatchPattern=smaller.SmallerThan)  # -> ListA, ListB

srf_ground = Surface(dispatch.ListB)
srf_river = Surface(dispatch.ListA)

num_streetwidths = Number(dup)
crv_streets_3 = Curve(flatten(join))

num_streetwidths_2 = Number(num_streetwidths)
crv_streets_4 = Curve(flatten(crv_streets_3))
srf_ground_2 = Surface(srf_ground)

brep = Brep([<brep referenced from the Rhino model> x11])

offset = OffsetCurve(Curve=graft(crv_streets_4), Distance=expr("x/2", graft(num_streetwidths_2)), Plane=PlaneXY(0, 0, 0), Corners=1)
offset_2 = OffsetCurve(Curve=graft(crv_streets_4), Distance=expr("-x/2", graft(num_streetwidths_2)), Plane=PlaneXY(0, 0, 0), Corners=1)
srfsplit_2 = SurfaceSplit(Surface=srf_ground_2, Curves=crv_streets_4)
graft_2 = GraftTree(Tree=srfsplit_2, IncludeEmptyLists=True, IncludeNullItems=True)
edges = BrepEdges(Brep=graft_2)  # -> Naked, Interior, NonManifold
join_2 = JoinCurves(Curves=edges.Naked, Preserve=False)
area_2 = Area(Geometry=join_2)  # -> Area, Centroid
flatten_2 = FlattenTree(Tree=area_2.Centroid, Path="{0}")

# ---- group: DeadEndSolving
end = EndPoints(Curve=offset)  # -> Start, End
end_2 = EndPoints(Curve=offset_2)  # -> Start, End
ln = Line(StartPoint=end.Start, EndPoint=end_2.Start)
ln_2 = Line(StartPoint=end.End, EndPoint=end_2.End)
join_3 = JoinCurves(Curves=[offset, offset_2, ln, ln_2], Preserve=False)

# ----
flatten_3 = FlattenTree(Tree=join_3, Path="{0}")
srfsplit_3 = SurfaceSplit(Surface=graft_2, Curves=flatten_3)
graft_3 = GraftTree(Tree=srfsplit_3, IncludeEmptyLists=True, IncludeNullItems=True)
srf_cp_2 = SurfaceClosestPoint(Point=flatten_2, Surface=graft_3)  # -> Point, UVPoint, Distance
sort_3 = SortList(Keys=srf_cp_2.Distance)  # -> Keys, ValuesA
item_4 = ListItem(List=sort_3.Keys, Index=0, Wrap=True)
smaller_2 = SmallerThan(FirstNumber=item_4, SecondNumber="0.1")  # -> SmallerThan, OrEqualTo
cull_2 = CullPattern(List=graft_3, CullPattern=smaller_2.SmallerThan)
edges_2 = BrepEdges(Brep=flatten(cull_2))  # -> Naked, Interior, NonManifold
join_4 = JoinCurves(Curves=edges_2.Naked, Preserve=False)
crv_blocks = Curve(flatten(join_4))

dispatch_2 = Dispatch(List=crv_blocks, DispatchPattern=[True, False])  # -> graft(ListA), graft(ListB)

pt_attractor_2 = Point(pt_attractor)
crv_blocks_2 = Curve(simplify(graft(dispatch_2.ListA)))
num_minwidth = Number("4")
num_maxwidth = Number("100")

crv_blocks_3 = Curve(simplify(graft(dispatch_2.ListB)))
num_buildingdensity = Number("1000")

bbox = BoundingBox(Content=crv_blocks_3, Plane=PlaneXY(0, 0, 0))  # -> Box, Box_2
area_3 = Area(Geometry=bbox.Box)  # -> Area, Centroid
division = Division(A=area_3.Area, B=num_buildingdensity)
pop2d = Populate2D(Region=bbox.Box, Count=division, Seed=1)  # -> simplify(Population)
incurve = PointInCurve(Point=pop2d, Curve=crv_blocks_3)  # -> Relationship, Point
cull_3 = CullPattern(List=pop2d, CullPattern=incurve.Relationship)
voronoi = Voronoi(Points=cull_3, Boundary=bbox.Box, BruteForceOverride=False)  # -> simplify(Cells)
boundary_3 = BoundarySurfaces(Edges=voronoi)
srfsplit_4 = SurfaceSplit(Surface=boundary_3, Curves=crv_blocks_3)
path_mapper_2 = PathMapper(srfsplit_4, source="{A;B}", target="{A}")
area_4 = Area(Geometry=path_mapper_2)  # -> Area, Centroid
incurve_2 = PointInCurve(Point=area_4.Centroid, Curve=crv_blocks_3)  # -> Relationship, Point
cull_4 = CullPattern(List=path_mapper_2, CullPattern=incurve_2.Relationship)
edges_3 = BrepEdges(Brep=cull_4)  # -> Naked, Interior, NonManifold
join_5 = JoinCurves(Curves=edges_3.Naked, Preserve=False)
reb = RebuildCurve(Curve=join_5, Degree="1", Count="4", Tangents=False)  # -> simplify(Curve)
path_mapper_3 = PathMapper(reb, source="{A;B}", target="{A}")
crv_buildingfootprints = Curve(path_mapper_3)

len = Length(Curve=crv_blocks_2)
area_5 = Area(Geometry=crv_blocks_2)  # -> Area, Centroid

dist_2 = Distance(PointA=area_5.Centroid, PointB=pt_attractor_2)
sort_4 = SortList(Keys=dist_2)  # -> Keys, ValuesA
item_5 = ListItem(List=sort_4.Keys, Index="0", Wrap=True)
bnd_2 = Bounds(Numbers=flatten(item_5))
remap_2 = RemapNumbers(Value=item_5, Source=bnd_2, Target=Domain(0, 1))  # -> Mapped, Clipped
graph = GraphMapper(
    remap_2.Mapped,
    x0=0,
    x1=1,
    y0=0,
    y1=1,
    container_name="Bezier",
    cpx=[0, 0.0983709842, 0.3127704859, 1],
    cpy=[0, 0.7168748379, 1, 1])
dom_2 = ConstructDomain(DomainStart=num_maxwidth, DomainEnd=num_minwidth)
remap_3 = RemapNumbers(Value=graph, Source=Domain(0, 1), Target=dom_2)  # -> Mapped, Clipped

division_2 = Division(A=len, B=remap_3.Mapped)
divide = DivideCurve(Curve=crv_blocks_2, Count=division_2, Kinks=False)  # -> Points, Tangents, Parameters
shift = ShiftList(List=divide.Points, Shift=1, Wrap=True)
ln_3 = Line(StartPoint=divide.Points, EndPoint=shift)
crv_building_fronts = Curve(ln_3)

crv_streets_5 = Curve(flatten(join))
crv_building_fronts_2 = Curve(simplify(graft(crv_building_fronts)))
pt_attractor_3 = Point(pt_attractor)
num_mindepth = Number("10")
num_maxdepth = Number("36")

midpt = CurveMiddle(Curve=crv_building_fronts_2)
crv_cp = CurveClosestPoint(Point=midpt, Curve=crv_streets_5)  # -> Point, Parameter, Distance
sort_5 = SortList(Keys=crv_cp.Distance, ValuesA=crv_cp.Point)  # -> Keys, ValuesA
item_6 = ListItem(List=sort_5.ValuesA, Index=0, Wrap=True)
vec2pt = Vector2Pt(PointA=item_6, PointB=midpt, Unitize=False)  # -> Vector, Length
end_3 = EndPoints(Curve=crv_building_fronts_2)  # -> Start, End

dist_3 = Distance(PointA=midpt, PointB=pt_attractor_3)
sort_6 = SortList(Keys=dist_3)  # -> Keys, ValuesA
item_7 = ListItem(List=sort_6.Keys, Index="0", Wrap=True)
bnd_3 = Bounds(Numbers=flatten(item_7))
remap_4 = RemapNumbers(Value=item_7, Source=bnd_3, Target=Domain(0, 1))  # -> Mapped, Clipped
graph_2 = GraphMapper(
    remap_4.Mapped,
    x0=0,
    x1=1,
    y0=0,
    y1=1,
    container_name="Bezier",
    cpx=[0, 0.194619, 0.04775956646, 1],
    cpy=[0, 0.6352002621, 1, 1])
dom_3 = ConstructDomain(DomainStart=num_maxdepth, DomainEnd=num_mindepth)
remap_5 = RemapNumbers(Value=graph_2, Source=Domain(0, 1), Target=dom_3)  # -> Mapped, Clipped

amp = Amplitude(Vector=vec2pt.Vector, Amplitude=remap_5.Mapped)
move_2 = Move(Geometry=crv_building_fronts_2, Motion=amp)  # -> Geometry, Transform
end_4 = EndPoints(Curve=move_2.Geometry)  # -> Start, End
merge = Merge(Data1=end_3.Start, Data2=end_3.End, Data3=end_4.End, Data4=end_4.Start)
pline_12 = PolyLine(Vertices=merge, Closed=True)
path_mapper_4 = PathMapper(pline_12, source="{A;B}", target="{A}")
crv_buildingfootprints_2 = Curve(path_mapper_4)

# ---- group: Topolography_Footprints
crv_buildingfootprints_3 = Curve([crv_buildingfootprints_2, crv_buildingfootprints])
srf_topo_2 = Surface(srf_topo)

cp = ControlPoints(Curve=crv_buildingfootprints_3)  # -> Points, Weights, Knots
Z_2 = UnitZ(Factor=1)
line = LineSDL(Start=cp.Points, Direction=Z_2, Length=1)
slx = SurfaceLine(Surface=srf_topo_2, Line=line, LimitToFirst=False)  # -> Curves, Points, UVPoints, Normal
path_mapper_5 = PathMapper(slx.Points, source="{A;B;C}", target="{A;B}")
pdecon = Deconstruct(Point=path_mapper_5)  # -> XComponent, YComponent, ZComponent
sort_7 = SortList(Keys=pdecon.ZComponent, ValuesA=path_mapper_5, ValuesB=cp.Points)  # -> Keys, ValuesA, ValuesB
item_8 = ListItem(List=sort_7.ValuesA, Index=0, Wrap=True)
item_9 = ListItem(List=sort_7.ValuesB, Index=0, Wrap=True)
vec2pt_2 = Vector2Pt(PointA=item_9, PointB=item_8, Unitize=False)  # -> Vector, Length
path_mapper_6 = PathMapper(vec2pt_2.Vector, source="{A;B}", target="{A}")
move_3 = Move(Geometry=crv_buildingfootprints_3, Motion=path_mapper_6)  # -> Geometry, Transform
crv_buildingfootprints_4 = Curve(move_3.Geometry)

# ----
crv_buildingfootprints_5 = Curve(crv_buildingfootprints_4)
num_maxheight = Number("30")
num_minmultiplier = Number("0.9")
num_maxmultiplier = Number("2")
num_minheight = Number("4")
pt_attractor_4 = Point(pt_attractor)

pcen = PolygonCenter(Polyline=crv_buildingfootprints_5)  # -> CenterV, CenterE, CenterA
avr = Average(Input=pcen.CenterV)
dom_4 = ConstructDomain(DomainStart=num_minmultiplier, DomainEnd=num_maxmultiplier)
lng_3 = ListLength(List=crv_buildingfootprints_5)
range = Range(Domain=dom_4, Steps=expr("x-1", lng_3))
jitter = Jitter(List=range, Jitter=1, Seed=2)  # -> Values, Indices

dist_4 = Distance(PointA=avr, PointB=pt_attractor_4)
sort_8 = SortList(Keys=dist_4)  # -> Keys, ValuesA
item_10 = ListItem(List=sort_8.Keys, Index="0", Wrap=True)
bnd_4 = Bounds(Numbers=flatten(item_10))
remap_6 = RemapNumbers(Value=item_10, Source=bnd_4, Target=Domain(0, 1))  # -> Mapped, Clipped
graph_3 = GraphMapper(
    remap_6.Mapped,
    x0=0,
    x1=1,
    y0=0,
    y1=1,
    container_name="Bezier",
    cpx=[0, 0.1159420311, 0.6521739364, 1],
    cpy=[0, 0.4206081033, 0.4662162066, 1])
dom_5 = ConstructDomain(DomainStart=num_maxheight, DomainEnd=num_minheight)
remap_7 = RemapNumbers(Value=graph_3, Source=Domain(0, 1), Target=dom_5)  # -> Mapped, Clipped

Z_3 = UnitZ(Factor=remap_7.Mapped)
dup_2 = DuplicateData(Data=Z_3, Number=lng_3, Order=True)
multiplication = Multiplication(A=jitter.Values, B=dup_2)

vec_heights = Vector(simplify(graft(multiplication)))
cp_2 = ControlPoints(Curve=crv_buildingfootprints_5)  # -> Points, Weights, Knots
item_11 = ListItem(List=cp_2.Points, Index="0", Wrap=True)
item_12 = ListItem(List=cp_2.Points, Index="1", Wrap=True)
item_13 = ListItem(List=cp_2.Points, Index="2", Wrap=True)
item_14 = ListItem(List=cp_2.Points, Index="3", Wrap=True)
move_4 = Move(Geometry=item_11, Motion=vec_heights)  # -> Geometry, Transform
move_5 = Move(Geometry=item_12, Motion=vec_heights)  # -> Geometry, Transform
move_6 = Move(Geometry=item_13, Motion=vec_heights)  # -> Geometry, Transform
move_7 = Move(Geometry=item_14, Motion=vec_heights)  # -> Geometry, Transform
tbox = TwistedBox(
    CornerA=item_11,
    CornerB=item_12,
    CornerC=item_13,
    CornerD=item_14,
    CornerE=move_4.Geometry,
    CornerF=move_5.Geometry,
    CornerG=move_6.Geometry,
    CornerH=move_7.Geometry)

mesh = Mesh(tbox)  # disabled
geo_buildingenvelope = Geometry(tbox)

brep_2 = Brep(geo_buildingenvelope)  # disabled

brep_3 = Brep(graft(geo_buildingenvelope))
bbox_2 = BoundingBox(Content=brep_3, Plane=PlaneXY(0, 0, 0))  # -> Box, Box_2
debox = DeconstructBox(Box=bbox_2.Box)  # -> Plane, X, Y, Z
dedomain = DeconstructDomain(Domain=debox.X)  # -> Start, End
dedomain_2 = DeconstructDomain(Domain=debox.Y)  # -> Start, End
dedomain_3 = DeconstructDomain(Domain=debox.Z)  # -> Start, End
subtraction = Subtraction(A=dedomain_3.End, B=dedomain_3.Start)
division_3 = Division(A=subtraction, B="4")
mesh_2 = MeshBrep(
    Brep=brep_3,
    Settings={GridMaxCount=0, GridMinCount=16, JaggedSeams=False, MaxEdgeLength=0, MinEdgeLength=0.0001, MinTolerance=0, Refine=True, RefineAngle=0, RelativeTolerance=0.65, SimplePlanes=True, Tolerance=0})
int = Integer(division_3)
division_4 = Division(A=subtraction, B=int)
addition = Addition(A=dedomain_3.Start, B=division_4)
pt_2 = ConstructPoint(XCoordinate=dedomain.Start, YCoordinate=dedomain_2.Start, ZCoordinate=addition)
box = CenterBox(Base=pt_2, X=division_4, Y=division_4, Z=1)
boxmap = BoxMapping(Mesh=mesh_2, Box=box)
path_2 = FilePath("D:\Desktop\cyber pattern.jpg")
previewmat = CustomPreviewMaterials(Geometry=boxmap, DiffuseColor=RGB(255, 255, 255), DiffuseBitmap=path_2)
mesh_mappedenveloped = Mesh(boxmap)
